# Grasshopper definition GHDebugSurface.gh (Grasshopper 1.0.7)

# ---- group: SurfaceFromAGridOfPoints
srf = Surface(reparameterize(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))
srfpt = SurfacePoints(Surface=srf)  # -> Points, Weights, Greville, UCount, VCount

# ---- group: SurfaceFrom4Points
srf4pt = _4PointSurface(CornerA="{0.0, 0.0, 0.0}", CornerB="{10.0, 0.0, 0.0}", CornerC="{10.0, 10.0, 2.0}", CornerD="{0.0, 10.0, 4.0}")  # -> reparameterize(Surface)

# ----
panel = Panel(srfpt.Weights)
panel_2 = Panel(srfpt.Points)
c_script = CSharpScript(srf=srf)  # -> out, surfsV, surfsU; inputs srf: Surface
# ---------- c_script: C# ----------
    surfsV = srf.Split(1, 0.5);
    surfsU = srf.Split(0, 0.5);
# ---------- end c_script ----------

# ---- group: PointAt and VectorAt
# All these definitions were used to convalidate and developed the GeometrySharp surfaces tests.
panel_3 = Panel("""{0.5,0.5,0.0}
{0.1,0.1,0.0}
{1,1,0.0}
{0.3,0.5,0.0}""")
evalsrf = EvaluateSurface(Surface=srf, Point=panel_3)  # -> Point, Normal, UDirection, VDirection, Frame
panel_4 = Panel(evalsrf.VDirection)
panel_5 = Panel(evalsrf.Point)

# ---- group: RationalDerivatives
c_script_2 = CSharpScript(srf=srf)  # -> out, derv0, dervs; inputs srf: Surface
# ---------- c_script_2: C# ----------
    Point3d pt;
    Vector3d[] derivis;
    srf.Evaluate(0.3, 0.5, 1, out pt, out derivis);
    dervs = derivis;
    derv0 = pt;
# ---------- end c_script_2 ----------
panel_6 = Panel(c_script_2.derv0)
panel_7 = Panel(c_script_2.dervs)

# ----
srfpt_2 = SurfacePoints(Surface=c_script.surfsU)  # -> Points, Weights, Greville, UCount, VCount
srfpt_3 = SurfacePoints(Surface=c_script.surfsV)  # -> Points, Weights, Greville, UCount, VCount
panel_8 = Panel(srfpt_2.Points)
panel_9 = Panel(srfpt_3.Points)
panel_10 = Panel(srfpt_3.UCount)
panel_11 = Panel(srfpt_2.UCount)
panel_12 = Panel(srfpt_3.VCount)
panel_13 = Panel(srfpt_2.VCount)
